# Grasshopper definition Create records with attachments.gh (Grasshopper 1.0.7)
# plug-ins: Mallard

panel = Panel("""P-E
P-W
P-N
P-S
T-E
T-W
T-N
T-S""")
text = Text(panel)

# ----
# Note:
# Using Mallard to include attachments in Airtable records,
# we will need valid url for upload.
panel_2 = Panel("http://ntustgm2020.anyday.com.tw/test/")
concatenate = Concatenate(FragmentA=panel_2, FolderName="Attachments", FragmentB="/", FragmentB_2=text, FragmentA_2=".jpg")
concatenate_2 = Concatenate(FragmentA=panel_2, FolderName="3DMesh", FragmentB="/", FragmentB_2=text, FragmentA_2=".json")
concatenate_3 = Concatenate(FragmentA=panel_2, FolderName="3DModel", FragmentB="/", FragmentB_2=text, FragmentA_2=".3dm")
cluster = Cluster(field_name="Attachments", urls=concatenate)
cluster_2 = Cluster(field_name="3DMesh", urls=concatenate_2)
cluster_3 = Cluster(field_name="3DModel", urls=concatenate_3)

concatenate_4 = Concatenate(FragmentA="GH_", FragmentB=text)
list_length = ListLength(List=concatenate_4)
repeat_data = RepeatData(Data="This record was created from grasshopper", Length=list_length)  # -> flatten(Data)
attachments_urls = Panel(cluster)
_3dmesh_urls = Panel(cluster_2)
_3dmodel_urls = Panel(cluster_3)
notes = Panel(repeat_data)
eid = Panel(concatenate_4)
building_part = Panel("""Podium
Podium
Podium
Podium
Tower
Tower
Tower
Tower""")
status = Panel("""Active
Active
Active
Active
Active
Active
Active
Active""")
zone = Panel("""East Facade
West Facade
North Facade
South Facade
East Facade
West Facade
North Facade
South Facade""")

text_2 = Text(status)
text_3 = Text(eid)
text_4 = Text(notes)
data = Data(cluster_3)
data_2 = Data(cluster_2)
data_3 = Data(cluster)
text_5 = Text(building_part)
text_6 = Text(zone)

field_names = Panel("""EID
Notes
3DModel
3DMesh
Attachments
Building Part
Zone
Status""")
entwine = Entwine(
    Branch00=text_3,
    Branch01=text_4,
    Branch02=data,
    Branch03=data_2,
    Branch04=data_3,
    Branch05=text_5,
    Branch06=text_6,
    Branch07=text_2,
    FlattenInputs=True)
flip_matrix = FlipMatrix(Data=entwine)
field_names_2 = Text(field_names)
field_names_3 = Panel(field_names_2)
fields = Data(simplify(flip_matrix))
fields_2 = Panel(fields)
app_key = Panel("keyrU68V6uFSOERBD")
view_name = Panel("Grid view")
base_id = Panel("appGRjtAqZHSlglzo")
table_name = Panel("LOD200")
create_airtable_record = CreateAirtableRecord(Refresh=Toggle(False), BaseID=base_id, AppKey=app_key, TableName=table_name, FieldNames=field_names_2, Fields=fields)  # -> ErrorMessage, OutRecord
panel_3 = Panel(create_airtable_record.OutRecord)
panel_4 = Panel(create_airtable_record.ErrorMessage)

# ==== cluster Cluster
field_name = ClusterInput()
urls = ClusterInput()
urls_2 = Text(graft(urls))
field_name_2 = Text(field_name)
serialize_json = SerializeJson(Url=urls_2, IncludeNullAndEmptyProperties=False)
serialize_keys_and_values = SerializeKeysAndValues(Key=field_name_2, Value=serialize_json)
deserialize_keys_and_values = DeserializeKeysAndValues(JSON=serialize_keys_and_values, Keys=field_name_2)  # -> Key, flatten(Attachments)
attachments = ClusterOutput(deserialize_keys_and_values.Attachments)
