# Grasshopper definition test-file.gh (Grasshopper 1.0.7)
# plug-ins: Mallard

list_airtable_records = ListAirtableRecords(
    Refresh=Toggle(False),
    BaseID="app3FVqxw4W8t9Pl8",
    AppKey="keyjNDU2X6XRFOsxc",
    TableName="Packing List",
    ViewName="Main View")  # -> ErrorMessage, OutRecords
panel = Panel(list_airtable_records.ErrorMessage)
panel_2 = Panel(list_airtable_records.OutRecords)
airtable_record_fields = AirtableRecordFields(Refresh=Toggle(False), Records=list_airtable_records.OutRecords, FieldName="Item")  # -> ErrorMessage, OutRecords
panel_3 = Panel(airtable_record_fields.OutRecords)
list_item = ListItem(List=list_airtable_records.OutRecords, Index=0, Wrap=True)
update_airtable_record = UpdateAirtableRecord(
    Refresh=Toggle(False),
    BaseID="app3FVqxw4W8t9Pl8",
    AppKey="keyjNDU2X6XRFOsxc",
    TableName="Packing List",
    FieldNames="Item",
    Fields="Bag",
    Records=list_item)  # -> ErrorMessage, OutRecord
panel_4 = Panel(update_airtable_record.ErrorMessage)
panel_5 = Panel(update_airtable_record.OutRecord)
