# Grasshopper definition Mallard2Test.ghx (Grasshopper 1.0.7)
# plug-ins: Mallard2

# ----
# In order to use this plugin you
# must create your own Airtable
# Account and Airtable Base, to
# obtain your API Key.
# 
# Once you have an account, api key
# Instructions can be found here:
# https://support.airtable.com/docs/how-do-i-get-my-api-key-
# Airtable Invite Link:
# Public Test Airtable Base
panel = Panel("app66Qat7yQxTfoGO")
list_airtable_records = ListAirtableRecords(BaseID=panel, AppKey="keywoE2IRwtnujrl9", TableName="Table 1", ViewName="Grid view")  # -> ErrorMessage, OutRecords

panel_2 = Panel("Attachments")
merge = Merge(Data1="Name", Data2="Notes", Data3="Status")
airtable_record_fields = AirtableRecordFields(Records=list_airtable_records.OutRecords, FieldName=graft(merge))
panel_3 = Panel(airtable_record_fields)

panel_4 = Panel("https://airtable.com/shrjsR8rqmuOH53bV")
panel_5 = Panel("https://airtable.com/invite/r/IXoNbQt3")
panel_6 = Panel(list_airtable_records.ErrorMessage)

list_item = ListItem(List=list_airtable_records.OutRecords, Index=Slider(2, range=0..10), Wrap=True)
delete_airtable_records = DeleteAirtableRecords(Refresh=Toggle(False), BaseID=panel, AppKey="keywoE2IRwtnujrl9", TableName="Table 1", RecordObject=list_item)  # -> ErrorMessage, OutRecord
panel_7 = Panel(delete_airtable_records.OutRecord)
panel_8 = Panel(delete_airtable_records.ErrorMessage)

create_airtable_records = CreateAirtableRecords(Toggle=Toggle(False), BaseID=panel, AppKey="keywoE2IRwtnujrl9", TableName="Table 1", FieldNames="Name", Fields="August")  # -> ErrorMessage, OutRecords
panel_9 = Panel(create_airtable_records.OutRecords)
panel_10 = Panel(create_airtable_records.ErrorMessage)

update_airtable_record = UpdateAirtableRecord(
    Refresh=Toggle(False),
    BaseID=panel,
    AppKey="keywoE2IRwtnujrl9",
    TableName="Table 1",
    RecordObject=list_airtable_records.OutRecords,
    FieldName="Notes",
    FieldValue="Fun summery name")  # -> ErrorMessage, OutRecord
panel_11 = Panel(update_airtable_record.ErrorMessage)
panel_12 = Panel(update_airtable_record.OutRecord)
